# Grasshopper definition Solihiya.gh (Grasshopper 1.0.7)
# plug-ins: Kangaroo2 Components, Weaverbird, HFTidyCanvas, MeshEdit Components

# ---- group: RH_IN: zHeight
number_slider = Slider(0.25, range=0..0.25)

# ---- group: RH_IN: solAngle
number_slider_2 = Slider(54, range=0..180)

# ---- group: RH_IN: toD
number_slider_3 = Slider(4, range=1..9)

# ---- group: RH_IN: smlOpening
number_slider_4 = Slider(0, range=0..40)

# ---- group: RH_IN: lrgOpening
number_slider_5 = Slider(45, range=0..45)

# ----
crv = Curve(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)
zheight = GetNumber(number_slider, AtLeast=1, AtMost=1, Maximum=0.05, Minimum=-1.797693135e+308)
solangle = GetNumber(number_slider_2, AtLeast=1, AtMost=1, Maximum=180, Minimum=-1.797693135e+308)
tod = GetNumber(number_slider_3, AtLeast=1, AtMost=1, Maximum=9, Minimum=-1.797693135e+308)
smlopening = GetNumber(number_slider_4, AtLeast=1, AtMost=1, Maximum=40, Minimum=-1.797693135e+308)
lrgopening = GetNumber(number_slider_5, AtLeast=1, AtMost=1, Maximum=40, Minimum=-1.797693135e+308)
explode = Explode(Curve=crv, Recursive=True)  # -> Segments, Vertices
boundary = BoundarySurfaces(Edges=crv)
qrsettings = QuadRemeshSettings(
    TargetCount=Slider(300, range=0..1000),
    AdaptiveSize=0,
    AdaptiveCount=invert(False),
    HardEdges=False,
    SeamEdges=0,
    Symmetry=0,
    GuideCurves=0)
mesh = MeshBrep(
    Brep=boundary,
    Settings={GridMaxCount=0, GridMinCount=16, JaggedSeams=False, MaxEdgeLength=0, MinEdgeLength=0.0001, MinTolerance=0, Refine=True, RefineAngle=0, RelativeTolerance=0.65, SimplePlanes=True, Tolerance=0})
qrmesh = QuadRemesh(Mesh=mesh, Settings=qrsettings)
cull = CullPattern(List=explode.Segments, CullPattern=[True, False, False])

nv = NakedVertices(Mesh=qrmesh)  # -> ClothedIndex, NakedIndex, ClothedPts, NakedPts
pull = PullPoint(Point=nv.NakedPts, Geometry=cull, ClosestOnly=True)  # -> ClosestPoint, Distance
edgelengths = EdgeLengths(Mesh=qrmesh, LengthFactor="1", Strength=1)
smaller = SmallerThan(FirstNumber=pull.Distance, SecondNumber=Slider(1e-05, range=0..1e-05))  # -> SmallerThan, OrEqualTo
cull_2 = CullPattern(List=pull.ClosestPoint, CullPattern=smaller.OrEqualTo)
pt = Point(cull_2)
vertexloads = VertexLoads(Mesh=qrmesh, Strength=zheight)
anchor = Anchor(Point=pt, Strength=10000)
show = Show(G=qrmesh)
merge = Merge(Data1=show, Data2=anchor, Data3=vertexloads, Data4=edgelengths)
zombiesolver = ZombieSolver(GoalObjects=merge, Threshold=1e-10, Tolerance=0.0001, MaxIterations=50000)  # -> I, V, O

number_slider_6 = Slider(100, range=0..100)
custom_mesh_settings = SettingsCustom(
    StitchSeams=True,
    SimplePlanes=False,
    Refine=True,
    MinCount=number_slider_6,
    MaxCount=number_slider_6,
    AspectRatio=20,
    MaxDistance=0,
    MaxAngle=20,
    MinEdge=0,
    MaxEdge=0)
bang = ExplodeTree(Data=zombiesolver.O)
item = ListItem(List=bang, Index=0, Wrap=True)
facen = FaceNormals(Mesh=item)  # -> Centers, Normals

bbox = BoundingBox(Content=crv, Plane=PlaneXY(0, 0, 0))  # -> Box, Box_2
debrep = DeconstructBrep(Brep=bbox.Box)  # -> Faces, Edges, Vertices
area = Area(Geometry=debrep.Faces)  # -> Area, Centroid
xy = XYPlane(Origin=Point(0, 0, 0))
sqrt = SquareRoot(Value=area.Area)
circle = CircleCNR(Center=area.Centroid, Normal=xy, Radius=sqrt)
sph = Sphere(Base=area.Centroid, Radius=sqrt)
divide = DivideCurve(Curve=circle, Count="2", Kinks=False)  # -> Points, Tangents, Parameters
item_2 = ListItem(List=divide.Points, Index=0, Wrap=True)  # -> Item, Item1
geodesic = Geodesic(Surface=sph, Start=item_2.Item, End=item_2.Item1)
ln = Line(StartPoint=item_2.Item, EndPoint=item_2.Item1)
rad = Radians(Degrees=solangle)

neg = Negative(Value=rad)

rot3d = Rotate3D(Geometry=geodesic, Angle=neg, Center=area.Centroid, Axis=ln)  # -> Geometry, Transform
divide_2 = DivideCurve(Curve=rot3d.Geometry, Count=10, Kinks=False)  # -> Points, Tangents, Parameters
item_3 = ListItem(List=divide_2.Points, Index=tod, Wrap=True)

boundary_2 = BoundarySurfaces(Edges=circle)
split = SplitBrep(Brep=sph, Cutter=boundary_2)
item_4 = ListItem(List=split, Index=0, Wrap=True)  # -> Item1, Item
mesh_2 = MeshBrep(Brep=[boundary_2, item_4.Item1], Settings=custom_mesh_settings)  # -> flatten(Mesh)
pt_2 = Point(item_3)
dist = Distance(PointA=facen.Centers, PointB=pt_2)
remap = Remap(data=dist, min=smlopening, max=lrgopening)
wbframe = WeaverbirdsPictureFrame(MeshPolylines=item, Distance=remap, InsetType=0)
wbcatmullclark = WeaverbirdsCatmullClarkSubdivision(MeshCurves=wbframe, Level=1, SmoothNakedEdges=1)
msphere = MeshSphere(Base=item_3, Radius=Slider(2, range=0..10), UCount=10, VCount=20)
medges = MeshEdges(Mesh=wbcatmullclark)  # -> NakedEdges, InteriorEdges, NonManifoldEdges
medges_2 = MeshEdges(Mesh=msphere)  # -> NakedEdges, InteriorEdges, NonManifoldEdges
curve = DataDescription(flatten([medges.InteriorEdges, medges.NakedEdges]))
curve_2 = DataDescription(flatten(medges_2.InteriorEdges))
curvepoint = PointOnCurve(curve, parameter=0.5)
curvepoint_2 = PointOnCurve(curve_2, parameter=0.5)
pt_3 = Point(item_3)
pt_4 = Point(item_3)
pull_2 = PullPoint(Point=curvepoint, Geometry=pt_3, ClosestOnly=True)  # -> ClosestPoint, Distance
pull_3 = PullPoint(Point=curvepoint_2, Geometry=pt_4, ClosestOnly=True)  # -> ClosestPoint, Distance
bnd = Bounds(Numbers=pull_2.Distance)
bnd_2 = Bounds(Numbers=pull_3.Distance)
remap_2 = RemapNumbers(Value=pull_2.Distance, Source=bnd, Target=Domain(0, 1))  # -> flatten(Mapped), Clipped
remap_3 = RemapNumbers(Value=pull_3.Distance, Source=bnd_2, Target=Domain(0, 1))  # -> flatten(Mapped), Clipped
gradient = Gradient(
    LowerLimit=0,
    UpperLimit=1,
    Parameter=remap_3.Mapped,
    stops=[0: RGB(255, 255, 0), 0: RGB(255, 255, 0), 1: RGB(255, 153, 0)])
gradient_2 = Gradient(
    LowerLimit=0,
    UpperLimit=1,
    Parameter=remap_2.Mapped,
    stops=[0: RGB(0, 34, 255), 0.5: RGB(255, 0, 85), 1: RGB(255, 153, 0)])
c_script = CSharpScript(crv=curve_2, color=gradient)  # -> out, A; inputs crv: Curve, color: Color
# ---------- c_script: C# ----------
    var c = color.R + "," + color.G + "," + color.B;
    crv.SetUserString("color", c);
    A = crv;
# ---------- end c_script ----------
c_script_2 = CSharpScript(crv=curve, color=gradient_2)  # -> out, A; inputs crv: Curve, color: Color; same code as c_script
flip = MeshFlip(Mesh=wbcatmullclark)

# ---- group: RH_OUT: Edges
rh_out_edges = Curve(c_script_2.A)

# ---- group: RH_OUT: Mesh
rh_out_mesh = Mesh(flip)

# ---- group: RH_OUT: Bound Curve
crv_2 = Curve(circle)

# ---- group: RH_OUT: Sun Curves
crv_3 = Curve(c_script.A)

# ---- group: RH_OUT: Sun
mesh_3 = Mesh(msphere)

# ---- group: RH_OUT: Sol Angle
rh_out_sol_angle = Curve(rot3d.Geometry)

# ---- group: RH_OUT: Plane
rh_out_plane = Brep(boundary_2)

# ---- group: RH_OUT: Mesh Plane
mesh_4 = Mesh(mesh_2)

# ==== cluster Remap: Remaps numbers
data = ClusterInput()
min = ClusterInput()
max = ClusterInput()
bnd = Bounds(Numbers=data)
dom = ConstructDomain(DomainStart=min, DomainEnd=max)
remap = RemapNumbers(Value=data, Source=bnd, Target=dom)  # -> Mapped, Clipped
R = ClusterOutput(remap.Mapped)
