# Grasshopper definition rnd_test.gh (Grasshopper 1.0.7)
# plug-ins: Kangaroo2 Components, Kangaroo Components

# ---- group: RH_IN:radius
radius = Slider(10, range=5..20)

# ---- group: RH_IN:count
count = Slider(5, range=2..20)

# ----
zheight = GetNumber(radius, AtLeast=1, AtMost=1, Maximum=1.797693135e+308, Minimum=-1.797693135e+308)
solangle = GetNumber(count, AtLeast=1, AtMost=1, Maximum=1.797693135e+308, Minimum=-1.797693135e+308)
sph = Sphere(Base=PlaneXY(0, 0, 0), Radius=zheight)
pt = ConstructPoint(XCoordinate=0, YCoordinate=0, ZCoordinate=0)
popgeo = PopulateGeometry(Geometry=sph, Count=solangle, Seed=1)
division = Division(A=zheight, B=solangle)
ln = Line(StartPoint=pt, EndPoint=popgeo)
mp = MultiPipe(Curves=ln, NodeSize=division, EndOffset=1, StrutSize=1, Segment=0, KinkAngle=0.6, CubeFit=0)
meshsubd = MeshFromSubD(SubD=mp, Density=2)
medges = MeshEdges(Mesh=meshsubd)  # -> NakedEdges, InteriorEdges, NonManifoldEdges
combine_clean = CombineClean(Meshes=meshsubd)
preview = CustomPreview(Geometry=meshsubd, Material=ColourSwatch(SwatchColor=RGB(255, 255, 255)))

# ---- group: RH_OUT:edges
crv = Curve([medges.NakedEdges, medges.InteriorEdges])

# ---- group: RH_OUT:mesh
mesh = Mesh(combine_clean)
