# Grasshopper definition solihiya_Test.gh (Grasshopper 1.0.7)
# plug-ins: Kangaroo2 Components

# ---- group: RH_In: zHeight
number_slider = Slider(0.05, range=0..0.05)

# ----
crv = Curve(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)
zheight = GetNumber(number_slider, AtLeast=1, AtMost=1, Maximum=0.05, Minimum=-1.797693135e+308)
boundary = BoundarySurfaces(Edges=crv)
explode = Explode(Curve=crv, Recursive=True)  # -> Segments, Vertices
qrsettings = QuadRemeshSettings(TargetCount=1000, AdaptiveSize=0, AdaptiveCount=invert(False), HardEdges=False, SeamEdges=0, Symmetry=0, GuideCurves=0)
mesh = MeshBrep(
    Brep=boundary,
    Settings={GridMaxCount=0, GridMinCount=16, JaggedSeams=False, MaxEdgeLength=0, MinEdgeLength=0.0001, MinTolerance=0, Refine=True, RefineAngle=0, RelativeTolerance=0.65, SimplePlanes=True, Tolerance=0})
qrmesh = QuadRemesh(Mesh=mesh, Settings=qrsettings)

nv = NakedVertices(Mesh=qrmesh)  # -> ClothedIndex, NakedIndex, ClothedPts, NakedPts
cull = CullPattern(List=explode.Segments, CullPattern=[False, True])
pull = PullPoint(Point=nv.NakedPts, Geometry=cull, ClosestOnly=True)  # -> ClosestPoint, Distance
smaller = SmallerThan(FirstNumber=pull.Distance, SecondNumber=Slider(1e-05, range=0..1e-05))  # -> SmallerThan, OrEqualTo
cull_2 = CullPattern(List=pull.ClosestPoint, CullPattern=smaller.OrEqualTo)
pt = Point(cull_2)
edgelengths = EdgeLengths(Mesh=qrmesh, LengthFactor="1", Strength=1)
anchor = Anchor(Point=pt, Strength=10000)
vertexloads = VertexLoads(Mesh=qrmesh, Strength=zheight)
show = Show(G=qrmesh)
merge = Merge(Data1=show, Data2=anchor, Data3=vertexloads, Data4=edgelengths)
zombiesolver = ZombieSolver(GoalObjects=merge, Threshold=1e-10, Tolerance=0.0001, MaxIterations=50000)  # -> I, V, O

bang = ExplodeTree(Data=zombiesolver.O)
item = ListItem(List=bang, Index=0, Wrap=True)
mesh_edges = MeshEdges(Mesh=item)  # -> NakedEdges, InteriorEdges, NonManifoldEdges
rh_out_edges = Curve([mesh_edges.NakedEdges, mesh_edges.InteriorEdges])
